# Grasshopper definition Linear Leisure Program.gh (Grasshopper 0.9.76)
# plug-ins: Anemone

genes = GenePool(Decimals=2, Maximum=100, Minimum=0, Value=[50, 50, 50, 50, 50, 50, 50, 50, 50, 50])
dom = ConstructDomain(DomainStart=Slider(40, range=0..100), DomainEnd=Slider(55, range=0..100))
高度的随机参量 = Slider(80, range=0..100)
高度的最大值 = Slider(5, range=0..100)
number_slider = Slider(23, range=0..100)
pt = Point(Point(43.2046537, -5.123330236, 0))
rectangle = Rectangle(Plane=PlaneXY(0, 0, 0), XSize=dom, YSize=Slider(15, range=0..20), Radius=0)  # -> Rectangle, Length
pt_2 = Point(Point(44.53032552, 20.50004279, 0))
dom_2 = ConstructDomain(DomainStart=0, DomainEnd=高度的最大值)
pop2d = Populate2D(Region=rectangle.Rectangle, Count=number_slider, Seed=Slider(54, range=0..100))  # -> flatten(Population)
subtraction = Subtraction(A=number_slider, B=1)
lng = ListLength(List=pop2d)
X = UnitX(Factor=Slider(21, range=0..100))
move = Move(Geometry=pt_2, Motion=X)  # -> flatten(Geometry), Transform
merge = Merge(Data1=move.Geometry, Data2=pop2d)
random = Random(Range=dom_2, Number=lng, Seed=高度的随机参量)
loop_start = LoopStart(Repeat=subtraction, Trigger=Toggle(True), Data_0=merge, Data_1=pt_2, Data_2=Slider(0, range=0..100))  # -> port, _22, Data_0, Data_1, Data_2
move_2 = Move(Geometry=pt, Motion=X)  # -> flatten(Geometry), Transform
sort = SortList(Keys=random)  # -> Keys, ValuesA
lng_2 = ListLength(List=random)
item = ListItem(List=loop_start.Data_0, Index=0, Wrap=True)
series = Series(Start=0, Step=1, Count=lng_2)
dist = Distance(PointA=item, PointB=loop_start.Data_0)
sort_2 = SortList(Keys=dist, ValuesA=loop_start.Data_0)  # -> Keys, ValuesA
mod = Modulus(A=series, B=2)
addition = Addition(A=loop_start.Data_2, B=1)
lng_3 = ListLength(List=sort_2.ValuesA)
dispatch = Dispatch(List=sort.Keys, DispatchPattern=mod)  # -> ListA, ListB
subtraction_2 = Subtraction(A=lng_3, B=1)
number_slider_2 = Slider(0, range=0..100)
rev = ReverseList(List=dispatch.ListB)
dom_3 = ConstructDomain(DomainStart=1, DomainEnd=subtraction_2)
item_2 = ListItem(List=sort_2.ValuesA, Index=1, Wrap=True)
subset = SubList(List=sort_2.ValuesA, Domain=dom_3, Wrap=True)  # -> flatten(List), Index
ins = InsertItems(List=loop_start.Data_1, Item=item_2, Indices=addition, Wrap=True)  # -> flatten(List)
ins_2 = InsertItems(List=ins, Item=move_2.Geometry, Indices=expr("x+1", number_slider), Wrap=True)
loop_end = LoopEnd(
    port=loop_start.port,
    Exit=False,
    Data_0=subset.List,
    Data_1=ins,
    Data_2=addition,
    pausedState=False,
    state="Constant output")  # -> Data_0, Data_1, Data_2
merge_2 = Merge(Data1=number_slider_2, Data2=flatten(dispatch.ListA), Data3=flatten(rev), Data4=number_slider_2)
Z = UnitZ(Factor=merge_2)
move_3 = Move(Geometry=ins_2, Motion=Z)  # -> Geometry, Transform
intcrv = Interpolate(Vertices=move_3.Geometry, Degree=Slider(3, range=0..10), Periodic=False, KnotStyle=1)  # -> Curve, Length, Domain
number_slider_3 = Slider(0.2, range=0..1)
number_slider_4 = Slider(0.795, range=0..10)
offset_l = OffsetLoose(Curve=intcrv.Curve, Distance=Slider(0.546, range=0..10))
offset_l_2 = OffsetLoose(Curve=intcrv.Curve, Distance=Slider(1.046, range=0..10))
Z_2 = UnitZ(Factor=Slider(-0.2, range=-1..1))
Z_3 = UnitZ(Factor=number_slider_4)
Z_4 = UnitZ(Factor=Slider(-0.03, range=-1..1))
move_4 = Move(Geometry=intcrv.Curve, Motion=Z_4)  # -> Geometry, Transform
move_5 = Move(Geometry=offset_l, Motion=Z_2)  # -> Geometry, Transform
move_6 = Move(Geometry=offset_l_2, Motion=Z_3)  # -> Geometry, Transform
move_7 = Move(Geometry=offset_l_2, Motion=Z_4)  # -> Geometry, Transform
move_8 = Move(Geometry=intcrv.Curve, Motion=Z_3)  # -> Geometry, Transform
merge_3 = Merge(Data1=move_4.Geometry, Data2=move_5.Geometry, Data3=move_7.Geometry)
loft = Loft(
    Curves=[intcrv.Curve, offset_l_2],
    Options={Adjust=False, Closed=False, LoftEnds=0, LoftSimp=0, LoftType=0, Rebuild=10, Refit=0.01})
loft_2 = Loft(Curves=merge_3, Options={Adjust=False, Closed=False, LoftEnds=0, LoftSimp=0, LoftType=0, Rebuild=10, Refit=0.01})
loft_3 = Loft(
    Curves=[offset_l_2, move_7.Geometry],
    Options={Adjust=False, Closed=False, LoftEnds=0, LoftSimp=0, LoftType=0, Rebuild=10, Refit=0.01})
loft_4 = Loft(
    Curves=[move_4.Geometry, intcrv.Curve],
    Options={Adjust=False, Closed=False, LoftEnds=0, LoftSimp=0, LoftType=0, Rebuild=10, Refit=0.01})
pipe = Pipe(Curve=[move_8.Geometry, move_6.Geometry], Radius=Slider(0.01, range=0..1), Caps=0)  # -> flatten(Pipe)
divide = DivideCurve(Curve=[offset_l_2, intcrv.Curve], Count=Slider(700, range=0..700), Kinks=False)  # -> Points, Tangents, Parameters
join = BrepJoin(Breps=[loft_2, loft_4, loft_3, loft, pipe])  # -> Breps, Closed
cyl = Cylinder(Base=divide.Points, Radius=Slider(0.002, range=0..0.1), Length=number_slider_4)
series_2 = Series(Start=0, Step=1, Count=10)
Z_5 = UnitZ(Factor=Slider(80, range=0..100))
move_9 = Move(Geometry=rectangle.Rectangle, Motion=Z_5)  # -> Geometry, Transform
move_10 = Move(Geometry=pop2d, Motion=Z_5)  # -> Geometry, Transform
move_11 = Move(Geometry=join.Breps, Motion=Z_5)  # -> Geometry, Transform
